# Grasshopper definition SpringPropertyPartial.gh (Grasshopper 1.0.7)
# Copyright: Arup
# plug-ins: UserDataUtils

Z = UnitZ(Factor=1)
rev = Reverse(Vector=Z)
Y = UnitY(Factor=1)
X = UnitX(Factor=1)
pt = ConstructPoint(XCoordinate="100", YCoordinate="100", ZCoordinate="100")
sbc = SchemaBuilderComponent(
    Origin=pt,
    Normal=rev,
    Xdir=Y,
    Ydir=X,
    assembly="SpeckleCoreGeometryClasses.SpecklePlane, SpeckleCoreGeometryClasses, Version=1.0.0.0, Culture=neutral, PublicKeyToken=null",
    init=True,
    type="SpecklePlane")
pt_2 = ConstructPoint(XCoordinate="1000", YCoordinate="2000", ZCoordinate="3000")
sbc_2 = SchemaBuilderComponent(
    BasePlane=sbc,
    assembly="SpeckleStructuralClasses.StructuralAxis, SpeckleStructuralClasses, Version=1.0.0.0, Culture=neutral, PublicKeyToken=null",
    init=True,
    type="StructuralAxis")
sbc_3 = SchemaBuilderComponent(
    DampingRatio="2",
    SpringType="Tension",
    ApplicationId="TestSPR1",
    Name="Test Spring Property 1",
    assembly="SpeckleStructuralClasses.StructuralSpringProperty, SpeckleStructuralClasses, Version=1.0.0.0, Culture=neutral, PublicKeyToken=null",
    init=True,
    type="StructuralSpringProperty")
sbc_4 = SchemaBuilderComponent(
    BasePoint=pt_2,
    Axis=sbc_2,
    Mass="20",
    Name="Moine",
    ApplicationId="N1",
    assembly="SpeckleStructuralClasses.StructuralNode, SpeckleStructuralClasses, Version=1.0.0.0, Culture=neutral, PublicKeyToken=null",
    init=True,
    type="StructuralNode")
sbc_5 = SchemaBuilderComponent(
    SpringType="Tension",
    ApplicationId="TestSPR2",
    Name="Test Spring Property 2",
    assembly="SpeckleStructuralClasses.StructuralSpringProperty, SpeckleStructuralClasses, Version=1.0.0.0, Culture=neutral, PublicKeyToken=null",
    init=True,
    type="StructuralSpringProperty")
anonymous_stream = DataSender(Nodes=sbc_4, Properties=sbc_3, manualmode=False, remotecontroller=False)  # -> Log, StreamId
panel = Panel(anonymous_stream.StreamId)
panel_2 = Panel(anonymous_stream.Log)
