# Grasshopper definition UnsetPropertyRefs.gh (Grasshopper 1.0.7)
# Copyright: Arup
# plug-ins: UserDataUtils

panel = Panel("""11
22
0""")
panel_2 = Panel("""10
20
0
0
0
0""")
line = Line(Line((-59, 126, 0), (51, -37, 0)))
num = Number(panel)
sbc = SchemaBuilderComponent(
    Value=num,
    assembly="SpeckleCoreGeometryClasses.SpeckleVector, SpeckleCoreGeometryClasses, Version=1.1.0.71, Culture=neutral, PublicKeyToken=null",
    init=True,
    type="SpeckleVector")
sbc_2 = SchemaBuilderComponent(
    BaseVector=sbc,
    assembly="SpeckleStructuralClasses.StructuralVectorThree, SpeckleStructuralClasses, Version=1.0.0.0, Culture=neutral, PublicKeyToken=null",
    init=True,
    type="StructuralVectorThree")
num_2 = Number(panel_2)
sbc_3 = SchemaBuilderComponent(
    BaseVector=sbc,
    assembly="SpeckleStructuralClasses.StructuralVectorThree, SpeckleStructuralClasses, Version=1.0.0.0, Culture=neutral, PublicKeyToken=null",
    init=True,
    type="StructuralVectorThree")
line_2 = Line(Line((-52, -35, 0), (95, 86, 0)))
rec = Rectangle({Plane=PlaneXY(8.5, 1, 0), Size=Domain2(u=-20.5..20.5, v=-10..10)})
sbc_4 = SchemaBuilderComponent(
    Value=num_2,
    assembly="SpeckleStructuralClasses.StructuralVectorSix, SpeckleStructuralClasses, Version=1.0.0.0, Culture=neutral, PublicKeyToken=null",
    init=True,
    type="StructuralVectorSix")
rec_2 = Rectangle({Plane=PlaneXY(0.5, 0, 0), Size=Domain2(u=-5.5..5.5, v=-3..3)})
mesh = Mesh(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)
pt = Point(Point(-60, 62, 0))
crv = Curve(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)
sbc_5 = SchemaBuilderComponent(
    assembly="SpeckleStructuralClasses.Structural2DThermalLoad, SpeckleStructuralClasses, Version=1.0.0.0, Culture=neutral, PublicKeyToken=null",
    init=True,
    type="Structural2DThermalLoad")
sbc_6 = SchemaBuilderComponent(
    GravityFactors=sbc_3,
    assembly="SpeckleStructuralClasses.StructuralGravityLoading, SpeckleStructuralClasses, Version=1.0.0.0, Culture=neutral, PublicKeyToken=null",
    init=True,
    type="StructuralGravityLoading")
sbc_7 = SchemaBuilderComponent(
    Thickness="100",
    ReferenceSurface="Top",
    assembly="SpeckleStructuralClasses.Structural2DProperty, SpeckleStructuralClasses, Version=1.0.0.0, Culture=neutral, PublicKeyToken=null",
    init=True,
    type="Structural2DProperty")
sbc_8 = SchemaBuilderComponent(
    BaseMesh=mesh,
    ElementType="Wall",
    assembly="SpeckleStructuralClasses.Structural2DElementMesh, SpeckleStructuralClasses, Version=1.0.0.0, Culture=neutral, PublicKeyToken=null",
    init=True,
    type="Structural2DElementMesh")
sbc_9 = SchemaBuilderComponent(
    Profile=rec_2,
    assembly="SpeckleStructuralClasses.Structural1DProperty, SpeckleStructuralClasses, Version=1.0.0.0, Culture=neutral, PublicKeyToken=null",
    init=True,
    type="Structural1DProperty")
sbc_10 = SchemaBuilderComponent(
    Profile=rec,
    assembly="SpeckleStructuralClasses.Structural1DProperty, SpeckleStructuralClasses, Version=1.0.0.0, Culture=neutral, PublicKeyToken=null",
    init=True,
    type="Structural1DProperty")
sbc_11 = SchemaBuilderComponent(
    BaseLine=line_2,
    assembly="SpeckleStructuralClasses.Structural1DElement, SpeckleStructuralClasses, Version=1.0.0.0, Culture=neutral, PublicKeyToken=null",
    init=True,
    type="Structural1DElement")
sbc_12 = SchemaBuilderComponent(
    BasePolyline=crv,
    Loading=sbc_2,
    assembly="SpeckleStructuralClasses.Structural2DLoadPanel, SpeckleStructuralClasses, Version=1.0.0.0, Culture=neutral, PublicKeyToken=null",
    init=True,
    type="Structural2DLoadPanel")
sbc_13 = SchemaBuilderComponent(
    BaseLine=line,
    assembly="SpeckleStructuralClasses.Structural1DElement, SpeckleStructuralClasses, Version=1.0.0.0, Culture=neutral, PublicKeyToken=null",
    init=True,
    type="Structural1DElement")
sbc_14 = SchemaBuilderComponent(
    Loading=sbc_2,
    assembly="SpeckleStructuralClasses.Structural2DLoad, SpeckleStructuralClasses, Version=1.0.0.0, Culture=neutral, PublicKeyToken=null",
    init=True,
    type="Structural2DLoad")
sbc_15 = SchemaBuilderComponent(
    BaseLine=line,
    Loading=sbc_4,
    assembly="SpeckleStructuralClasses.Structural1DLoadLine, SpeckleStructuralClasses, Version=1.0.0.0, Culture=neutral, PublicKeyToken=null",
    init=True,
    type="Structural1DLoadLine")
sbc_16 = SchemaBuilderComponent(
    BasePoint=pt,
    assembly="SpeckleStructuralClasses.Structural0DSpring, SpeckleStructuralClasses, Version=1.0.0.0, Culture=neutral, PublicKeyToken=null",
    init=True,
    type="Structural0DSpring")
sbc_17 = SchemaBuilderComponent(
    Loading=sbc_4,
    assembly="SpeckleStructuralClasses.Structural0DLoad, SpeckleStructuralClasses, Version=1.0.0.0, Culture=neutral, PublicKeyToken=null",
    init=True,
    type="Structural0DLoad")
sbc_18 = SchemaBuilderComponent(
    Loading=sbc_4,
    assembly="SpeckleStructuralClasses.Structural1DLoad, SpeckleStructuralClasses, Version=1.0.0.0, Culture=neutral, PublicKeyToken=null",
    init=True,
    type="Structural1DLoad")
anonymous_stream = DataSender(
    A=[sbc_11, sbc_13],
    B=[sbc_9, sbc_10],
    C=sbc_7,
    D=sbc_16,
    E=sbc_8,
    F=sbc_17,
    G=sbc_18,
    H=sbc_15,
    I=sbc_14,
    J=sbc_12,
    K=sbc_5,
    L=sbc_6,
    DebouncingDisabled=False,
    manualmode=False,
    remotecontroller=False)  # -> Log, StreamId
